# Grasshopper definition taffy_consolidated_Edit_07_1pw2.gh (Grasshopper 1.0.7)
# plug-ins: Human UI, Human, BH.UI.Grasshopper

ladybug = Ladybug_Ladybug()  # -> Vviiiiiiiiiizzz; plug-in component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
honeybee = Honeybee_Honeybee()  # -> Vviiiiiiiiiizzz; plug-in component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

# ---- group: Inputs 1
building_length = Slider(260, range=150..300)
bay_size_x = Slider(17, range=10..35)
bay_size_y = Slider(17, range=10..35)
floor_to_ceiling = Slider(10, range=9..10)
lease_depth = Slider(42, range=35..60)
core_width = Slider(4, range=2..12)
number_slider = Slider(4, range=0..20)
property_line = Curve(<curve referenced from the Rhino model>)

# ----
first_floor_height = Slider(20, range=16..30)

# ---- group: First Floor Glazing
number_slider_2 = Slider(0.11, range=0..0.95)
# Input Sliders for Facade Creation
number_slider_3 = Slider(0.31, range=0..0.95)
number_slider_4 = Slider(0.52, range=0..0.95)
number_slider_5 = Slider(0.6, range=0..0.95)

# ---- group: Upper Floor Glazing
number_slider_6 = Slider(0.11, range=0..0.95)
number_slider_7 = Slider(0.52, range=0..0.95)
number_slider_8 = Slider(0.6, range=0..0.95)
number_slider_9 = Slider(0.31, range=0..0.95)

# ---- group: Geometry creation from Andrew S
far_calc = GhPythonScript(property_line=property_line, FAR=number_slider)  # -> out, max_area, centroid
# ---------- far_calc: Python ----------
__author__ = "ASwartzell"
__version__ = "2020.10.17"

import rhinoscriptsyntax as rs

area = rs.CurveArea(property_line)[0]



max_area = area*FAR
centroid = rs.CurveAreaCentroid(property_line)[0]
# ---------- end far_calc ----------
convert_units = GhPythonScript()  # -> out, dbl_scale, str_system, str_area, str_length
# ---------- convert_units: Python ----------
"""Provides a scripting component.
    Inputs):
        x): The x script variable
        y): The y script variable
    Output):
        a): The a output variable"""

__author__ = "ASwartzell"
__version__ = "2020.10.17"

import rhinoscriptsyntax as rs

units = rs.UnitSystem()
if(units == 0):
    dbl_scale = 0
    str_system = "none"
elif(units == 1): #Microns (1.0e-6 meters)
    dbl_scale = 1.0e-6
    str_system = "metric"
elif(units == 2):    #Millimeters (1.0e-3 meters)
    dbl_scale = 1.0e-3
    str_system = "metric"
elif(units == 3):    #Centimeters (1.0e-2 meters)
    dbl_scale = 1.0e-2
    str_system = "metric"
elif(units == 4):    #Meters
    dbl_scale = 1
    str_system = "metric"
elif(units == 5):    #Kilometers (1.0e+3 meters)
    dbl_scale = 1.0e+3
    str_system = "none"
elif(units == 6):    #Microinches (2.54e-8 meters, 1.0e-6 inches)
    dbl_scale = 2.54e-8
    str_system = "none"
elif(units == 7):    #Mils (2.54e-5 meters, 0.001 inches)
    dbl_scale = 2.54e-5
    str_system = "imperial"
elif(units == 8):    #Inches (0.0254 meters)
    dbl_scale = .0254
    str_system = "imperial"
elif(units == 9):    #Feet (0.3048 meters, 12 inches)
    dbl_scale = .3048
    str_system = "imperial"
elif(units == 10):    #Miles (1609.344 meters, 5280 feet)
    dbl_scale = 1609.344
    str_system = "none"
elif(units == 11):    #Reserved Custom Unit str_system
    dbl_scale = 0
    str_system = "none"
elif(units == 12):    #Angstroms (1.0e-10 meters)
    dbl_scale = 1.0e-10
    str_system = "none"
elif(units == 13):    #Nanometers (1.0e-9 meters)
    dbl_scale = 1.0e-9
    str_system = "none"
elif(units == 14):    #Decimeters (1.0e-1 meters)
    dbl_scale = 1.0e-1
    str_system = "metric"
elif(units == 15):    #Dekameters (1.0e+1 meters)
    dbl_scale = 1.0e+1
    str_system = "metric"
elif(units == 16):    #Hectometers (1.0e+2 meters)
    dbl_scale = 1.0e+2
    str_system = "metric"
elif(units == 17):    #Megameters (1.0e+6 meters)
    dbl_scale = 1.0e+6
    str_system = "none"
elif(units == 18):    #Gigameters (1.0e+9 meters)
    dbl_scale = 1.0e+9
    str_system = "none"
elif(units == 19):    #Yards (0.9144  meters, 36 inches)
    dbl_scale = .9144
    str_system = "imperial"
elif(units == 20):    #Printer point (1/72 inches, computer points)
    dbl_scale = .0254/72
    str_system = "none"
elif(units == 21):    #Printer pica (1/6 inches, (computer picas)
    dbl_scale = .0254/6
    str_system = "none"
elif(units == 22):    #Nautical mile (1852 meters)
    dbl_scale = 1852
    str_system = "none"
elif(units == 23):    #Astronomical (1.4959787e+11)
    dbl_scale = 1.4959787e+11
    str_system = "none"
elif(units == 24):    #Lightyears (9.46073e+15 meters)
    dbl_scale = 9.46073e+15
    str_system = "none"
elif(units == 25):    #Parsecs (3.08567758e+16)
    dbl_scale = 3.08567758e+16
    str_system = "none"

if(str_system == "imperial"):
    str_area = " sf"
    str_length = " ft"
    #convert dbl_scale to feet
    dbl_scale = dbl_scale / .3048
elif(str_system == "metric"):
    str_area = " m2"
    str_length = " m"
# ---------- end convert_units ----------
convert_area = GhPythonScript(area=far_calc.max_area, dbl_scale=convert_units.dbl_scale)  # -> out, area
# ---------- convert_area: Python ----------
__author__ = "ASwartzell"
__version__ = "2020.10.17"

import rhinoscriptsyntax as rs

area = area * (dbl_scale * dbl_scale)
# ---------- end convert_area ----------
list = ValueList({"Beam Depth from Top of Slab": 0, "Beam Depth does not include Slab": 1}, selected="Beam Depth from Top of Slab")
gross_area = Panel(convert_area.area)
core_components = X(10)
list_2 = ValueList({"Center Core": 2, "Side Core": 1}, selected="Center Core")
beam_depth = Beam_depth(27)
area_per_lift = Area_per_lift(50000)
raised_floor = Raised_floor(0)
slab_depth = Slab_depth(6)
first_floor = X(first_floor_height)
plenum = Mechanical(25)
tower_parameters = GhPythonScript(
    gross_area=convert_area.area,
    area_per_lift=area_per_lift,
    core_components=core_components,
    core_type=list_2,
    core_width=core_width,
    lease_depth=lease_depth,
    raised_floor=raised_floor,
    slab_depth=slab_depth,
    include_slab=list,
    beam_depth=beam_depth,
    plenum=plenum,
    ceiling_height=floor_to_ceiling,
    first_floor=first_floor,
    building_length=building_length)  # -> out, building_width, building_height, building_length, floor_height, num_floors, core_length, core_width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
# ---------- tower_parameters: Python ----------
__author__ = "ASwartzell"
__version__ = "2020.10.17"

import rhinoscriptsyntax as rs

core_width = core_width * core_components
building_width = core_type * lease_depth + core_width

#some of these are in inches
#beam depth includes slab depth
floor_height = ceiling_height+(plenum+beam_depth+raised_floor+slab_depth*include_slab)/12

int_elevators = round(gross_area / area_per_lift)
int_elevator_banks = round((int_elevators*core_components/2) / core_width)
int_stairs = 2
core_length = core_components*(int_stairs+int_elevator_banks*3+3)

core_area = core_width * core_length

#try this length to start
if building_length is None:
    building_length = lease_depth * 2 + core_length
    
    floor_area = building_width*building_length
    num_floors = round((gross_area-core_area) / floor_area)
    
    building_height = first_floor + (num_floors-1)*(floor_height) + 1
    core_height = building_height + 20
    
    if(core_height > 420):
        int_stairs += 1
        
    if(num_floors * floor_area + core_area > gross_area):
        num_floors -= 1
        building_height = first_floor + (num_floors-1)*(floor_height) + 1
        core_height = building_height + 20
    
    floor_area = (gross_area-core_area)/num_floors
    building_length = floor_area/building_width
else:
    floor_area = building_width*building_length
    num_floors = round((gross_area-core_area) / floor_area)
    
    building_height = first_floor + (num_floors-1)*(floor_height) + 1
    core_height = building_height + 20
    
    if(core_height > 420):
        int_stairs += 1

gross_area = floor_area * num_floors + core_area
# ---------- end tower_parameters ----------
xy = XYPlane(Origin=Point(0, 0, 0))
pl_origin = PlaneOrigin(Base=xy, Origin=far_calc.centroid)
division = Division(A=[tower_parameters.building_width, tower_parameters.core_width], B=convert_units.dbl_scale)
division_2 = Division(A=[tower_parameters.building_height, tower_parameters.core_height], B=convert_units.dbl_scale)
division_3 = Division(A=[tower_parameters.building_length, tower_parameters.core_length], B=convert_units.dbl_scale)
subtraction = Subtraction(A=tower_parameters.num_floors, B=1)
division_4 = Division(A=tower_parameters.floor_height, B=convert_units.dbl_scale)
division_5 = Division(A=first_floor, B=convert_units.dbl_scale)
panel = Panel(tower_parameters.gross_area)
multiplication = Multiplication(A=division, B=-0.5)
multiplication_2 = Multiplication(A=division_3, B=-0.5)
rectangle = Rectangle(Plane=pl_origin, XSize=division, YSize=division_3, Radius=0)  # -> Rectangle, Length
panel_2 = Panel(tower_parameters.num_floors)
series = Series(Start=division_5, Step=division_4, Count=subtraction)
Y = UnitY(Factor=multiplication_2)
X = UnitX(Factor=multiplication)
Z = UnitZ(Factor=series)
move = Move(Geometry=rectangle.Rectangle, Motion=Y)  # -> Geometry, Transform
move_2 = Move(Geometry=move.Geometry, Motion=X)  # -> Geometry, Transform
move_3 = Move(Geometry=move_2.Geometry, Motion=graft(Z))  # -> Geometry, Transform
item = ListItem(List=move_3.Geometry, Index=0, Wrap=True)
item_2 = ListItem(List=move_2.Geometry, Index=1, Wrap=True)
boxrec = BoxRectangle(Rectangle=move_2.Geometry, Height=division_2)
boxrec_2 = BoxRectangle(Rectangle=item, Height=division_4)
item_3 = ListItem(List=boxrec, Index=0, Wrap=True)

# ----
maximum = Maximum(A=bay_size_x, B=bay_size_y)

construct_point = ConstructPoint(XCoordinate=0, YCoordinate=0, ZCoordinate=0)
construct_point_2 = ConstructPoint(
    XCoordinate=tower_parameters.core_width,
    YCoordinate=tower_parameters.core_length,
    ZCoordinate=tower_parameters.core_height)
box_2pt = Box2Pt(PointA=construct_point_2, PointB=construct_point, Plane=PlaneXY(0, 0, 0))
number_slider_10 = Slider(5, range=0..10)
deconstruct_brep = DeconstructBrep(Brep=box_2pt)  # -> Faces, Edges, Vertices
cull_nth = CullNth(List=deconstruct_brep.Faces, CullFrequency=Slider(4, range=0..4))

no_floors = Data(tower_parameters.num_floors)
deconstruct_brep_2 = DeconstructBrep(Brep=boxrec_2)  # -> Faces, Edges, Vertices

# ---- group: ground floor object to array
item_4 = ListItem(List=flatten(boxrec_2), Index=0, Wrap=True)  # -> Item, Item1

# ----
list_item = ListItem(List=deconstruct_brep_2.Faces, Index=Slider(4, range=0..4), Wrap=True)
panel_3 = Panel(list_item)
list_3 = ValueList({"Double-Pane, Annealed": 0, "Double-Pane, Tempered": 1, "Triple-Pane, Annealed": 2, "Triple-Pane, Tempered": 3}, selected="Double-Pane, Annealed")

# ---- group: Window Creator first floor
toggle = BooleanToggle(True)
mass2zone = Honeybee_Masses2Zones(zoneMasses=flatten(item_4.Item), maxRoofAngle=30, createHBZones=toggle)  # -> readMe, HBZones; plug-in component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
facparam = HBFacadeParameters(north=number_slider_2, east=number_slider_4, south=number_slider_5, west=number_slider_3)  # -> fac_par; plug-in component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
glazingcreator = Honeybee_GlazingBasedOnRatio(HBObjects=mass2zone.HBZones, glzRatio=facparam, runIt=toggle)  # -> readMe, HBObjWGLZ; plug-in component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
decomposebytype = Honeybee_DecomposeBasedOnType(HBZone=glazingcreator.HBObjWGLZ)  # -> walls, interiorWalls, airWalls, windows, interiorWindows, skylights, roofs, ceilings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; plug-in component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

# ---- group: Window Creator upper floors
toggle_2 = BooleanToggle(True)
mass2zone_2 = Honeybee_Masses2Zones(zoneMasses=flatten(item_4.Item1), maxRoofAngle=30, createHBZones=toggle_2)  # -> readMe, HBZones; plug-in component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
facparam_2 = HBFacadeParameters(north=number_slider_6, east=number_slider_7, south=number_slider_8, west=number_slider_9)  # -> fac_par; plug-in component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
glazingcreator_2 = Honeybee_GlazingBasedOnRatio(HBObjects=mass2zone_2.HBZones, glzRatio=facparam_2, runIt=toggle_2)  # -> readMe, HBObjWGLZ; plug-in component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
decomposebytype_2 = Honeybee_DecomposeBasedOnType(HBZone=glazingcreator_2.HBObjWGLZ)  # -> walls, interiorWalls, airWalls, windows, interiorWindows, skylights, roofs, ceilings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; plug-in component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

# ----
panel_4 = Panel("""1
2
3""")

# ---- group: v6--Get Window GWP
window_data = Data(Tree({0;0}: ["#split Glass fiber composite material based window profile - general, enhanced and high end models", "Glass Mineral Wool Insulation with ECOSE® Technology (040 - 046 W/mK)", "GLAPOR cellular glass", "Glass mineral wool insulation λ 0.032-0.033 W/mK", "Glass mineral wool insulation λ 0.031-0.033 W/mK", "Glass Mineral Wool Insulation with ECOSE® Technology (0.036 - 0.039 W/mK)"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], {0;1}: ["The fiberglass window profiles from CPIC can be used in various new construction and renovation projects. The products are essentially composed of glass fibers and resin, materials that expand and contract very little with temperature changes in the weather, and also provide the final products with increased energy efficiency and added strength. At the same time, the surface of the profile can be treated differently according to the customer's needs, to meet diverse process and performance requirements of the customer. As a “new generation” product after traditional wooden, steel, aluminium and PVC window profile, fiberglass window profile has excellent air tightness, water tightness, wind pressure resistance, outstanding sound insulation and thermal insulation performance, and can also meet the requirements of fire resistance. It is a new type of product with various impressive characteristics. Therefore, it is grabbing a bigger share of the replacement window market every year.", "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", "Product definition GLAPOR cellular glass boards cellular glass products are vapour-tight, lightweight insulation materials for the construction industry made of 100 % recycled glass.", "Glass Mineral Wool is lightweight, easily installed and provides outstanding levels of thermal performance and acoustic absorption. Our wide range of non-combustible Glass Mineral Wool products are designed to provide solutions for all types of roofs, walls and floors in new build and refurbishment of both residential and non-residential buildings. Our high performance Glass Mineral Wool insulation solutions contain high quality recycled glass, to which sand, limestone and soda ash are added before being melted in a furnace, and spun to form millions of fine strands of wool. We use our proprietary and revolutionary ECOSE® Technology binder to bind the mineral wool strands together to form a mat of material which is then cured in order to form the final product. ECOSE® Technology is our unique bio-based binder* which is used in the manufacture of all of our Glass Mineral Wool products. Invented over 10 years ago and still unique to Knauf Insulation, it is very much central to our sustainability strategy.", "Glass Mineral Wool is lightweight, easily installed and provides outstanding levels of thermal performance and acoustic absorption. Our wide range of non-combustible Glass Mineral Wool products are designed to provide solutions for all types of roofs, walls and floors in new build and refurbishment of both residential and non-residential buildings. Our high performance Glass Mineral Wool insulation solutions contain high quality recycled glass, to which sand, limestone and soda ash are added before being melted in a furnace, and spun to form millions of fine strands of wool. We use our proprietary and revolutionary ECOSE® Technology binder to bind the mineral wool strands together to form a mat of material which is then cured in order to form the final product. ECOSE® Technology is our unique bio-based binder* which is used in the manufacture of all of our Glass Mineral Wool products. Invented over 10 years ago and still unique to Knauf Insulation, it is very much central to our sustainability strategy.", "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"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], {0;2}: ["Chongqing Polycomp International Corporation", "Knauf Insulation", "GLAPOR Werk Mitterteich GmbH", "Knauf Insulation", "Knauf Insulation", "Knauf Insulation", "Knauf Insulation", "Knauf Insulation", "Georgia-Pacific Building Products", ""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], {0;3}: [nan, 0.415, 12.8, 3.06, 5.12, 0.673, 0.877, 0.415, nan, nan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], {0;4}: [], {0;5}: [1, 10.5, 1, 29, 48, 15, 21, 10.5, 1, 1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], {0;6}: ["", "", "", "", "", "", "", "", "", ""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]))
panel_5 = Panel("https://www.cardinalcorp.com/source/pdf/epd/533.EPD_for_Cardinal_Glass_Industries_Insulating_Glass_Products.pdf")
window_data_2 = ListItem(List=window_data, Index=12, Wrap=True)  # -> Item, Item1, Item2, Item3
entwine = Entwine(
    Branch00=window_data_2.Item3,
    Branch01=window_data_2.Item2,
    Branch02=window_data_2.Item,
    Branch03=window_data_2.Item1,
    FlattenInputs=True)
windowdetails = Panel(window_data_2.Item1)
python = GhPythonScript(linkToEPD=panel_5, windowSelector=list_3, windowData=entwine)  # -> out, windowGWP_SF; inputs windowData: tree
# ---------- python: Python ----------
winObj = windowData.Branch(windowSelector)
winGWP_M = winObj[3]

#Convert GWP from m2 to SF
windowGWP_SF = winGWP_M/10.7639104
# ---------- end python ----------

# ---- group: v3 -- array opaque facades / wall geo -- array per floor
wall_geo____floor_1 = Geometry(decomposebytype.walls)

# ---- group: v6--GWP Map for Mullions
panel_6 = Panel("https://www.kawneer.com/kawneer/united_kingdom/pdf/kawneer_curtain_wall_epd.pdf")
windowsrfs = Surface(decomposebytype.windows)
windowcrvs = Curve(decomposebytype.windows)
python_2 = GhPythonScript(linkToEPD=panel_6, windowSrfs=windowsrfs, windowCrvs=windowcrvs, floorNum=subtraction)  # -> out, perFloorGWP, totalGWP; inputs windowSrfs: list, windowCrvs: list
# ---------- python_2: Python ----------
import rhinoscriptsyntax as rs
import math

#mullion embodied carbon value
emCarb_lm = 57.6678 #Pulled from Kawneer EPD, based on A1-A3 per linear meter
embodiedCarbon = emCarb_lm/3.2808399

perFloorGWP = 0

for i, win in enumerate(_windowSrfs):
    if rs.Area(win) <= 50: #If the area is under 50SF, probably no intermediate mullions
        perFloorGWP += rs.CurveLength(_windowCrvs[i])*embodiedCarbon
    elif rs.Area(win) > 50:
        perFloorGWP += rs.CurveLength(_windowCrvs[i])*embodiedCarbon
        
        #Find height curve
        #Assume this will always be the shortest length
        expCrvs = rs.ExplodeCurves(_windowCrvs[i])
        crvLens = []
        for crv in expCrvs:
            crvLens.append(rs.CurveLength(crv))
        
        #Array the vertical mullion across the face at 12' space
        perFloorGWP += math.floor(max(crvLens)/12)*(min(crvLens)*embodiedCarbon)

if floorNum:
    totalGWP = perFloorGWP*floorNum
else:
    totalGWP = None
# ---------- end python_2 ----------

# ---- group: v6--GWP map for Windows / windows -- array per floor
windows_geo____first_floor = Geometry(decomposebytype.windows)

# ---- group: v6--GWP map for Windows
windows_geo____upper_floors = Geometry(decomposebytype_2.windows)
cluster = Cluster(G_2=windows_geo____first_floor, G=windows_geo____upper_floors, B=python.windowGWP_SF, F=division_4, N=subtraction)  # -> R, geometry_2
element_gwp = Panel(cluster.R)

# ---- group: floor geo -- array per floor
geo = Geometry(decomposebytype.exposedFloors)

# ---- group: v6--GWP map for mullions
panel_7 = Panel("https://www.kawneer.com/kawneer/united_kingdom/pdf/kawneer_curtain_wall_epd.pdf")
windowcrvs_2 = Curve(decomposebytype_2.windows)
windowsrfs_2 = Surface(decomposebytype_2.windows)
python_3 = GhPythonScript(linkToEPD=panel_7, windowSrfs=windowsrfs_2, windowCrvs=windowcrvs_2)  # -> out, perFloorGWP, totalGWP; inputs windowSrfs: list, windowCrvs: list; same code as python_2

# ---- group: roof/ceiling geo -- count 1
geo_2 = Geometry(decomposebytype.roofs)

# ----
panel_8 = Panel(geo)
data = Data(tower_parameters.gross_area)
ec3_concrete_lw_2501_3000 = EC3_Concrete_LW_25013000(
    {"2501-3000 psi 0-19 % SCM (FA/SL) Lightweight Concrete": 0, "2501-3000 psi 20-29 % SCM (FA) Lightweight Concrete": 1, "2501-3000 psi 30-39 % SCM (FA) Lightweight Concrete": 2, "2501-3000 psi 30-39 % SCM (SL) Lightweight Concrete": 3, "2501-3000 psi 40-49 % SCM (FA) Lightweight Concrete": 4, "2501-3000 psi 40-49 % SCM (SL) Lightweight Concrete": 5, "2501-3000 psi 50-100 % SCM (FA/SL) Lightweight Concrete": 6, "2501-3000 psi 50-100 % SCM (SL) Lightweight Concrete": 7}, selected="2501-3000 psi 30-39 % SCM (FA) Lightweight Concrete",
    Component="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",
    Selection=2)
ec3_steel = EC3_Steel(
    {"CRSI Fabricated Steel Reinforcement - USA wide": 0, "Cold-Formed Steel Studs and Track": 1, "Fabricated Hot-Rolled Structural Steel Sections": 2, "Fabricated Steel Plate": 3, "Fabricated hollow structural steel sections": 4, "Fabricated hot-rolled structural steel sections": 5, "Galvanized Steel Plate": 6, "Open Web Steel Joists": 7, "Steel Roof and Floor Deck": 8}, selected="Steel Roof and Floor Deck",
    Component="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",
    Selection=8)
ec3_timber = EC3_Timber(
    {"North American Oriented Strand Board": 0, "Laminated Strand Lumber": 1, "North American Laminated Veneer Lumber": 2, "North American Softwood Plywood": 3, "North American Glued Laminated Timbers": 4, "Laminated Strand Lumber": 5, "North American Wood I-Joists": 6, "North American Softwood Lumber": 7, "Nordic X-Lam": 8, "Crosslam": 9}, selected="Crosslam",
    Component="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",
    Selection=9)
merge = Merge(Data1=ec3_timber, Data2=ec3_concrete_lw_2501_3000, Data3=ec3_steel)

# ---- group: add GWP info to object
toggle_3 = BooleanToggle(True)
carbonquerydatabaseadapter = CarbonQueryDatabaseAdapter(Username="llombardi@thorntontomasetti.com", Password="EClomba7&", Active=toggle_3, Component="{ ..ctor")
cqdconfig = CQDConfig(
    Count=Slider(100, range=0..100),
    NameLike="glass",
    WrapNonBHoMObjects=False,
    AllowHashForComparing=False,
    DiffConfig="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",
    Component="BH.oM.Adapters.CarbonQueryDatabase.CQDConfig")
createtype = CreateType(Component="BH.oM.LifeCycleAssessment.MaterialFragments.EnvironmentalProductDeclaration")
pull = Pull(
    Adapter=carbonquerydatabaseadapter,
    Request=createtype,
    PullType="{ \"_t\" : \"System.Enum\", \"TypeName\" : { \"_t\" : \"System.Type\", \"Name\" : \"BH.oM.Adapter.PullType\" }, \"Value\" : \"AdapterDefault\" }",
    ActionConfig=cqdconfig,
    Active=toggle_3,
    Component="{ .Pull")
explode = Explode(Object=pull, Component="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")  # -> QuantityType, LifeCycleAssessmentPhases, Manufacturer, Plant, PostalCode, IndustryStandards, Id, Density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

# ----
divide = DivideDomain²(UCount=Slider(30, range=0..100), VCount=Slider(15, range=0..100))
ec3_concrete_lw_2501_3000_2 = EC3_Concrete_LW_25013000(
    {"2501-3000 psi 0-19 % SCM (FA/SL) Lightweight Concrete": 0, "2501-3000 psi 20-29 % SCM (FA) Lightweight Concrete": 1, "2501-3000 psi 30-39 % SCM (FA) Lightweight Concrete": 2, "2501-3000 psi 30-39 % SCM (SL) Lightweight Concrete": 3, "2501-3000 psi 40-49 % SCM (FA) Lightweight Concrete": 4, "2501-3000 psi 40-49 % SCM (SL) Lightweight Concrete": 5, "2501-3000 psi 50-100 % SCM (FA/SL) Lightweight Concrete": 6, "2501-3000 psi 50-100 % SCM (SL) Lightweight Concrete": 7}, selected="2501-3000 psi 0-19 % SCM (FA/SL) Lightweight Concrete",
    Component="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",
    Selection=0)
data_2 = Data(list_item)
subsrf = Isotrim(Domain=divide)
data_3 = Data(flatten(data_2))
# EC3_Steel - Steel Roof and Floor Deck
# 
# 2501-3000psi 30 -39 SC Lightweight Conrete
# 2501-3000psi 30 -39 SC Lightweight Conrete
panel_9 = Panel("GWP Facade Assembly")
area = Area(Geometry=subsrf)  # -> Area, Centroid

# ---- group: Floor
divide_2 = DivideDomain²(Domain=geo, UCount=Slider(30, range=0..100), VCount=Slider(15, range=0..100))
subsrf_2 = Isotrim(Surface=geo, Domain=divide_2)
number_slider_11 = Slider(0.5, range=0..1)
area_2 = Area(Geometry=subsrf_2)  # -> Area, Centroid
cir = Circle(Plane=area_2.Centroid, Radius=number_slider_11)
Z_2 = UnitZ(Factor=1)
extr = Extrude(Base=cir, Direction=Z_2)

# ----
data_4 = Data(area_2.Centroid)
brep = Brep(data_3)
cir_2 = Circle(Plane=data_4, Radius=Slider(0.5, range=0..1))
wall = Data(cull_nth)

ec3_concrete_lw_2501_3000_3 = EC3_Concrete_LW_25013000(
    {"2501-3000 psi 0-19 % SCM (FA/SL) Lightweight Concrete": 0, "2501-3000 psi 20-29 % SCM (FA) Lightweight Concrete": 1, "2501-3000 psi 30-39 % SCM (FA) Lightweight Concrete": 2, "2501-3000 psi 30-39 % SCM (SL) Lightweight Concrete": 3, "2501-3000 psi 40-49 % SCM (FA) Lightweight Concrete": 4, "2501-3000 psi 40-49 % SCM (SL) Lightweight Concrete": 5, "2501-3000 psi 50-100 % SCM (FA/SL) Lightweight Concrete": 6, "2501-3000 psi 50-100 % SCM (SL) Lightweight Concrete": 7}, selected="2501-3000 psi 30-39 % SCM (FA) Lightweight Concrete",
    Component="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",
    Selection=2)
ec3_steel_2 = EC3_Steel(
    {"CRSI Fabricated Steel Reinforcement - USA wide": 0, "Cold-Formed Steel Studs and Track": 1, "Fabricated Hot-Rolled Structural Steel Sections": 2, "Fabricated Steel Plate": 3, "Fabricated hollow structural steel sections": 4, "Fabricated hot-rolled structural steel sections": 5, "Galvanized Steel Plate": 6, "Open Web Steel Joists": 7, "Steel Roof and Floor Deck": 8}, selected="Steel Roof and Floor Deck",
    Component="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",
    Selection=8)
wall_2 = Wall(
    Location=wall,
    Construction="{ \"_t\" : \"BH.oM.Physical.Constructions.Construction\", \"BHoM_Guid\" : \"ce74c68d-a8b8-4775-b71f-cc9bab9873f3\", \"Name\" : \"\", \"Fragments\" : [], \"Tags\" : [], \"CustomData\" : { }, \"Layers\" : [] }",
    Offset="{ \"_t\" : \"System.Enum\", \"TypeName\" : { \"_t\" : \"System.Type\", \"Name\" : \"BH.oM.Physical.Elements.Offset\" }, \"Value\" : \"Centre\" }",
    Component="BH.oM.Physical.Elements.Wall")
addfragment = AddFragment(IBHoMObject=wall_2, Fragment=ec3_steel_2, Replace=False, Component="{ .AddFragment")

entwine_2 = Entwine(
    Branch00="GWP Columns",
    Branch01="GWP Floors",
    Branch02="GWP Walls",
    Branch03="GWP Glazing",
    Branch04=panel_9,
    FlattenInputs=True)  # -> flatten(Result)
mesh = Mesh(brep)
Z_3 = UnitZ(Factor=Slider(14, range=1..20))
extr_2 = Extrude(Base=cir_2, Direction=Z_3)
move_4 = Move(Geometry=cir_2, Motion=Z_3)  # -> Geometry, Transform
box = CenterBox(Base=PlaneXY(0, 0, 0), X=1, Y=1, Z=1)
box_2 = CenterBox(Base=PlaneXY(0, 0, 0), X=1, Y=1, Z=1)
panel_10 = Panel(pull)
area_3 = Area(Geometry=move_4.Geometry)  # -> Area, Centroid
_3dview = Create3DView(
    MeshToDisplay=box,
    MeshColors=ColourSwatch(SwatchColor=RGB(161, 161, 161)),
    ViewWidth=Slider(600, range=0..1000),
    ViewHeight=300)
entwine_3 = Entwine(Branch00=mesh, Branch01=extr_2, FlattenInputs=True)  # -> flatten(Result)
_3dview_2 = Create3DView(
    MeshToDisplay=box_2,
    MeshColors=ColourSwatch(SwatchColor=RGB(161, 161, 161)),
    ViewWidth=Slider(600, range=0..1000),
    ViewHeight=300)
panel_11 = Panel(explode.Name)
setprop = SetElementProperty(UIElement=_3dview, PropertyName="Height", ValueToSet=Slider(395, range=0..800))
panel_12 = Panel(explode.GlobalWarmingPotential)

# ---- group: Wall HUD / Evaluate EPD
environmentalproductdeclarationfield = EnvironmentalProductDeclarationField(
    {"AcidificationPotential": 0, "AcidificationPotentialEndOfLife": 1, "DepletionOfAbioticResourcesFossilFuels": 2, "DepletionOfAbioticResourcesFossilFuelsEndOfLife": 3, "EutrophicationPotential": 4, "EutrophicationPotentialEndOfLife": 5, "GlobalWarmingPotential": 6, "GlobalWarmingPotentialEndOfLife": 7, "OzoneDepletionPotential": 8, "OzoneDepletionPotentialEndOfLife": 9, "PhotochemicalOzoneCreationPotential": 10, "PhotochemicalOzoneCreationPotentialEndOfLife": 11}, selected="GlobalWarmingPotential",
    Component="BH.oM.LifeCycleAssessment.EnvironmentalProductDeclarationField",
    Selection=6)
evaluateenvironmentalproductdeclarationp = EvaluateEnvironmentalProductDeclarationPerObject(
    Obj=addfragment,
    Field=environmentalproductdeclarationfield,
    Component="{ .EvaluateEnvironmentalProductDeclarationPerObject")

# ----
set3dview = Set3DView(_3DView=_3dview_2, MeshToDisplay=entwine_3, MeshColors=ColourSwatch(SwatchColor=RGBA(88, 113, 135, 116)))
entwine_4 = Entwine(Branch00=_3dview_2, FlattenInputs=True)  # -> flatten(Result)
expander = CreateExpander(UIElements=_3dview, Header="FACADE", Open=True)
expander_2 = CreateExpander(UIElements=entwine_4, Header="STRUCTURAL ELEMENTS", Open=True)
data_5 = Data(area_2.Centroid)
button = CreateButton(ButtonName=["Image Capture", "CSV Export", "PDF Export"], ButtonStyle=0)
panel_13 = Panel("""Embodied Carbon
Export Findings""")
launchwin = LaunchWindow(Show=Toggle(True), Name="EZ_EC", Width=370, Height=400, ChildStatus=0, EnableHorizScroll=False)
data_6 = Data(tower_parameters.num_floors)

# ---- group: v3--get assembly types and gwps
name_data = Data(["MV - Granite", "MV - Limestone", "MV - Brick", "FS - Insulated Metal Panel", "CW - Spandrel", "RS - UHPC (fibreC)", "RS - GFRC", "RS - ACM", "RS - Terracotta", "RS - Phenolic Resin", "RS - Fiber Cement", "RS - Formed Zinc Panel", "RS - Granite", "RS - Limestone", "RS -  Formed Steel Panel", "RS - Wood"])
list_4 = ValueList({"Product": 1, "Transportation": 2, "Maintenance": 3}, selected="Product")
assembly_data = Data(Tree({0}: ["MV - Granite", "18.28514101", "0.351365021", "0.044990208"], {1}: ["MV - Limestone", "11.54573152", "0.329121005", "0.044990208"], {2}: ["MV - Brick", "8.629073875", "0.204327931", "0.044990208"], {3}: ["FS - Insulated Metal Panel", "9.171245913", "0.079361387", "0.044990208"], {4}: ["CW - Spandrel", "15.90686277", "0.223044971", "0.044990208"], {5}: ["RS - UHPC (fibreC)", "15.19133007", "0.158533689", "0.044990208"]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))

# ----
list_5 = ItemSelector(
    name_data,
    {"MV - Granite", "MV - Limestone", "MV - Brick", "FS - Insulated Metal Panel", "CW - Spandrel", "RS - UHPC (fibreC)", "RS - GFRC", "RS - ACM", "RS - Terracotta", "RS - Phenolic Resin", "RS - Fiber Cement", "RS - Formed Zinc Panel", "RS - Granite", "RS - Limestone", "RS -  Formed Steel Panel": "RS - Formed Steel Panel", "RS - Wood"}, selected="RS - ACM")
item_5 = ListItem(List=assembly_data, Index=panel_4, Wrap=True)

# ---- group: v3--get assembly types and gwps (continued)
python_4 = GhPythonScript(assembly=list_5, attributes=list_4, dB=assembly_data)  # -> out, GWP; inputs attributes: list, dB: tree
# ---------- python_4: Python ----------
GWP = 0

for i in range(dB.BranchCount):
    object = dB.Branch(i)
    
    if object[0] == assembly:
        for y in attributes:
            GWP += float(object[y])
# ---------- end python_4 ----------
panel_14 = Panel(python_4.GWP)

# ----
lng = ListLength(List=assembly_data)
ma = MassAddition(Input=flatten(item_5))  # -> Result, PartialResults
min = Minimum(A=python_4.GWP, B=ma.Result)
panel_15 = Panel(min)
gwpopaque = Data(flatten(python_4.GWP))
gwpopaque_2 = Data(flatten(python_4.GWP))
data_7 = Data(panel_14)

# ---- group: v3 -- array opaque facades
wall_geo____upper_floors = Geometry(decomposebytype_2.walls)

# ----
cluster_2 = Cluster(G_2=wall_geo____floor_1, G=wall_geo____upper_floors, B=python_4.GWP, F=division_4, N=subtraction)  # -> R, geometry_2

# ---- group: v3 -- array opaque facades (continued)
element_gwp_2 = Panel(cluster_2.R)

# ----
division_6 = Division(A=element_gwp_2, B=data)
panel_16 = Panel(element_gwp_2)
data_8 = Data(division_6)
wallopaque = Data(flatten(cluster_2.geometry_2))
wallopaque_2 = Data(flatten(cluster_2.geometry_2))
lng_2 = ListLength(List=wallopaque)
lng_3 = ListLength(List=wallopaque_2)
dup = DuplicateData(Data=gwpopaque, Number=lng_2, Order=True)
dup_2 = DuplicateData(Data=gwpopaque_2, Number=lng_3, Order=True)
data_9 = Data(data_8)
brep_2 = Brep(wallopaque)
wires = BrepWireframe(Brep=brep_2, Density=-1)
mesh_2 = Mesh(brep_2)
shapes = CreateShapes(Shapes=wires, FillColor=ColourSwatch(SwatchColor=RGB(161, 161, 161)), StrokeColor=RGB(0, 0, 0), Scale=1, ClickMode=3)
set3dview_2 = Set3DView(_3DView=_3dview, MeshToDisplay=mesh_2, MeshColors=ColourSwatch(SwatchColor=RGBA(88, 113, 135, 116)))

list_of_materials = Panel("""wood
concrete
steel""")
panel_17 = Panel("""25
40
45""")
number_slider_12 = Slider(0, range=0..1)
dim = Dimensions(Surface=subsrf_2)  # -> UDimension, VDimension
min_2 = Minimum(A=dim.UDimension, B=dim.VDimension)

# ---- group: input type of material as string corresponding with the list of materials
item_6 = ListItem(List=list_of_materials, Index=number_slider_12, Wrap=True)

# ---- group: createDictionary
python_5 = GhPythonScript(x=list_of_materials, y=panel_17, z=item_6)  # -> out, a; inputs x: list, y: list
# ---------- python_5: Python ----------
__author__ = "Pat"
__version__ = "2020.10.17"

import rhinoscriptsyntax as rs

dictt = {}

for i in range(0,len(x)):
    dictt[x[i]]=y[i]
print dictt

a = dictt[z]
# ---------- end python_5 ----------

# ----
division_7 = Division(A=min_2, B=python_5.a)
expression = Expression(x=division_7, Expression="if(x<0.5,0.5,x)")

item_7 = ListItem(List=merge, Index=number_slider_12, Wrap=True)
layer = Layer(Name=item_6, Thickness=Slider(0.4, range=0..5), Component="{ .Layer")
construction = Construction(Name=ec3_concrete_lw_2501_3000_2, Layers=layer, Component="{ .Construction")
fragment = Data(item_7)

floor = Floor(
    Location=simplify(list_item),
    Construction=construction,
    Offset="{ \"_t\" : \"System.Enum\", \"TypeName\" : { \"_t\" : \"System.Type\", \"Name\" : \"BH.oM.Physical.Elements.Offset\" }, \"Value\" : \"Centre\" }",
    Component="BH.oM.Physical.Elements.Floor")
addfragment_2 = AddFragment(IBHoMObject=floor, Fragment=fragment, Replace=False, Component="{ .AddFragment")

panel_18 = Panel(fragment)

# ---- group: Floor HUD / Evaluate EPD
environmentalproductdeclarationfield_2 = EnvironmentalProductDeclarationField(
    {"AcidificationPotential": 0, "AcidificationPotentialEndOfLife": 1, "DepletionOfAbioticResourcesFossilFuels": 2, "DepletionOfAbioticResourcesFossilFuelsEndOfLife": 3, "EutrophicationPotential": 4, "EutrophicationPotentialEndOfLife": 5, "GlobalWarmingPotential": 6, "GlobalWarmingPotentialEndOfLife": 7, "OzoneDepletionPotential": 8, "OzoneDepletionPotentialEndOfLife": 9, "PhotochemicalOzoneCreationPotential": 10, "PhotochemicalOzoneCreationPotentialEndOfLife": 11}, selected="GlobalWarmingPotential",
    Component="BH.oM.LifeCycleAssessment.EnvironmentalProductDeclarationField",
    Selection=6)
evaluateenvironmentalproductdeclarationp_2 = EvaluateEnvironmentalProductDeclarationPerObject(
    Obj=addfragment_2,
    Field=environmentalproductdeclarationfield_2,
    Component="{ .EvaluateEnvironmentalProductDeclarationPerObject")

# ---- group: add GWP info to object / Evaluate EPD
environmentalproductdeclarationfield_3 = EnvironmentalProductDeclarationField(
    {"AcidificationPotential": 0, "AcidificationPotentialEndOfLife": 1, "DepletionOfAbioticResourcesFossilFuels": 2, "DepletionOfAbioticResourcesFossilFuelsEndOfLife": 3, "EutrophicationPotential": 4, "EutrophicationPotentialEndOfLife": 5, "GlobalWarmingPotential": 6, "GlobalWarmingPotentialEndOfLife": 7, "OzoneDepletionPotential": 8, "OzoneDepletionPotentialEndOfLife": 9, "PhotochemicalOzoneCreationPotential": 10, "PhotochemicalOzoneCreationPotentialEndOfLife": 11}, selected="GlobalWarmingPotential",
    Component="BH.oM.LifeCycleAssessment.EnvironmentalProductDeclarationField",
    Selection=6)

# ----
ec3_concrete_lw_2501_3000_4 = EC3_Concrete_LW_25013000(
    {"2501-3000 psi 0-19 % SCM (FA/SL) Lightweight Concrete": 0, "2501-3000 psi 20-29 % SCM (FA) Lightweight Concrete": 1, "2501-3000 psi 30-39 % SCM (FA) Lightweight Concrete": 2, "2501-3000 psi 30-39 % SCM (SL) Lightweight Concrete": 3, "2501-3000 psi 40-49 % SCM (FA) Lightweight Concrete": 4, "2501-3000 psi 40-49 % SCM (SL) Lightweight Concrete": 5, "2501-3000 psi 50-100 % SCM (FA/SL) Lightweight Concrete": 6, "2501-3000 psi 50-100 % SCM (SL) Lightweight Concrete": 7}, selected="2501-3000 psi 30-39 % SCM (SL) Lightweight Concrete",
    Component="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",
    Selection=3)
move_5 = Move(Geometry=cir, Motion=Z_2)  # -> Geometry, Transform
area_4 = Area(Geometry=move_5.Geometry)  # -> Area, Centroid
concretecircularsection = ConcreteCircularSection(Diameter=number_slider_11, MinimumCover=0, Component="{ .ConcreteCircularSection")

data_10 = Data(area_4.Centroid)
ln = Line(StartPoint=data_4, EndPoint=data_10)
data_11 = Data(area_4.Centroid)

bar = Bar(
    StartNode=data_5,
    EndNode=data_11,
    SectionProperty=concretecircularsection,
    OrientationAngle=0,
    FEAType="{ \"_t\" : \"System.Enum\", \"TypeName\" : { \"_t\" : \"System.Type\", \"Name\" : \"BH.oM.Structure.Elements.BarFEAType\" }, \"Value\" : \"Flexural\" }",
    Component="BH.oM.Structure.Elements.Bar")
addfragment_3 = AddFragment(IBHoMObject=bar, Fragment=ec3_concrete_lw_2501_3000_4, Replace=False, Component="{ .AddFragment")

# ---- group: add GWP info to object / Evaluate EPD (continued)
evaluateenvironmentalproductdeclarationp_3 = EvaluateEnvironmentalProductDeclarationPerObject(
    Obj=addfragment_3,
    Field=environmentalproductdeclarationfield_3,
    Component="{ .EvaluateEnvironmentalProductDeclarationPerObject")

# ---- group: add GWP info to object / Explore Results
totalglobalwarmingpotential = TotalGlobalWarmingPotential(GwpResults=evaluateenvironmentalproductdeclarationp_3, Component="{ .TotalGlobalWarmingPotential")  # -> flatten(Gwp)

# ----
mass_addition = MassAddition(Input=totalglobalwarmingpotential)  # -> Result, PartialResults
panel_19 = Panel(totalglobalwarmingpotential)
multiplication_3 = Multiplication(A=mass_addition.Result, B=data_6)

# ---- group: add GWP info to object / Explore Results (continued)
panel_20 = Panel(multiplication_3)

# ----
division_8 = Division(A=multiplication_3, B=tower_parameters.gross_area)
panel_21 = Panel(division_8)
data_12 = Data(panel_21)

# ---- group: Floor HUD / Explore Results
totalglobalwarmingpotential_2 = TotalGlobalWarmingPotential(GwpResults=evaluateenvironmentalproductdeclarationp_2, Component="{ .TotalGlobalWarmingPotential")  # -> flatten(Gwp)

# ---- group: Floor HUD
panel_22 = Panel(totalglobalwarmingpotential_2)
mass_addition_2 = MassAddition(Input=totalglobalwarmingpotential_2)  # -> Result, PartialResults
division_9 = Division(A=mass_addition_2.Result, B=tower_parameters.gross_area)
panel_23 = Panel(division_9)

# ----
data_13 = Data(panel_23)

# ---- group: Floor HUD / Explore Results (continued)
panel_24 = Panel(mass_addition_2.Result)

# ---- group: Wall HUD / Explore Results
totalglobalwarmingpotential_3 = TotalGlobalWarmingPotential(GwpResults=evaluateenvironmentalproductdeclarationp, Component="{ .TotalGlobalWarmingPotential")  # -> flatten(Gwp)

# ---- group: Wall HUD
mass_addition_3 = MassAddition(Input=totalglobalwarmingpotential_3)  # -> Result, PartialResults
panel_25 = Panel(totalglobalwarmingpotential_3)
division_10 = Division(A=mass_addition_3.Result, B=tower_parameters.gross_area)
panel_26 = Panel(division_10)

# ----
data_14 = Data(panel_26)
entwine_5 = Entwine(Branch00=data_12, Branch01=data_13, Branch02=data_14, Branch03=data_9, Branch04=data_7, FlattenInputs=True)  # -> flatten(Result)
panel_27 = Panel(entwine_5)
chart = CreateChart(Data=entwine_5, Names=entwine_2, Title="Embodied Carbon mad Eeazy", ChartType=1)
chartappearance = ChartAppearance(ChartToModify=chart)
entwine_6 = Entwine(Branch00=chart, Branch01=expander, Branch02=expander_2, FlattenInputs=True)
tabs = TabbedView(TabNames=panel_13, TabTextSize="16", Tab0=flatten(entwine_6), Tab1=flatten(button))
addelems = AddElements(Window=launchwin, Elements=flatten(tabs), DoVLChecking=True)  # -> AddedElements, ElementNames

# ---- group: Wall HUD / Explore Results (continued)
panel_28 = Panel(mass_addition_3.Result)

# ==== cluster Cluster
F = ClusterInput()
N = ClusterInput()
B = ClusterInput()
G = ClusterInput()
G_2 = ClusterInput()
Z = UnitZ(Factor=F)
area = Area(Geometry=G_2)  # -> Area, Centroid
arrlinear = LinearArray(Geometry=G, Direction=Z, Count=N)  # -> Geometry, Transform
area_2 = Area(Geometry=G)  # -> Area, Centroid
multiplication = Multiplication(A=area_2.Area, B=B)
multiplication_2 = Multiplication(A=area.Area, B=B)
multiplication_3 = Multiplication(A=multiplication, B=N)
ma = MassAddition(Input=multiplication_2)  # -> Result, PartialResults
ma_2 = MassAddition(Input=multiplication_3)  # -> Result, PartialResults
merge = Merge(Data1=ma.Result, Data2=ma_2.Result)
ma_3 = MassAddition(Input=merge)  # -> Result, PartialResults
geometry = Data(arrlinear.Geometry)
geometry_2 = ClusterOutput(geometry)
R = ClusterOutput(ma_3.Result)
